# Grasshopper definition main.gh (Grasshopper 1.0.7)
# plug-ins: Wallacei

# ---- group: Base line
# 01-subdivision base
geometry_pipeline = GeometryPipeline(
    GroupByLayer=False,
    GroupByType=False,
    IncludeHidden=True,
    IncludeLocked=True,
    LayerFilter="boundary",
    NameFilter="*",
    SublayerFiltering=True,
    TypeFilter=4)
geometry_pipeline_2 = GeometryPipeline(
    GroupByLayer=False,
    GroupByType=False,
    IncludeHidden=True,
    IncludeLocked=True,
    LayerFilter="boundary_back",
    NameFilter="*",
    SublayerFiltering=True,
    TypeFilter=4)
project = Project(Geometry=geometry_pipeline, Plane=PlaneXY(0, 0, 0))  # -> Geometry, Transform

# ---- group: Split direction
wlc_split_direction = GenePool(Decimals=0, Maximum=1, Minimum=0, Value=[0, 1, 0, 0, 0, 1, 0])
split_direction = Panel(wlc_split_direction)

# ---- group: Split degree
wlc_split_degree = GenePool(Decimals=6, Maximum=1, Minimum=0, Value=[0.590673, 0.985532, 0.703814, 0.455083, 0.742581, 0.61968, 0.066616])
split_degree = Panel(wlc_split_degree)

# ---- group: Floors num
wlc_floors_num = GenePool(Decimals=0, Maximum=6, Minimum=4, Value=[5, 5, 5, 6, 6, 6, 6, 4])
floors_number = Panel(wlc_floors_num)

# ---- group: Subdivision base
split_base = GhPythonScript(
    project_base=project.Geometry,
    split_direction=wlc_split_direction,
    split_degree=wlc_split_degree,
    setback="5",
    rotate_angle=Slider(72, range=0..100))  # -> out, splited_space, setbacked_base; inputs project_base: Curve, split_direction: list of Int32, split_degree: list
# ---------- split_base: Python ----------
# coding=utf-8
"""
                       _oo0oo_
                      o8888888o
                      88" . "88
                      (| -_- |)
                      0\  =  /0
                    ___/`---'\___
                  .' \\|     |// '.
                 / \\|||  :  |||// \
                / _||||| -:- |||||- \
               |   | \\\  - /// |   |
               | \_|  ''\---/''  |_/ |
               \  .-\__  '-'  ___/-. /
             ___'. .'  /--.--\  `. .'___
          ."" '<  `.___\_<|>_/___.' >' "".
         | | :  `- \`.;`\ _ /`;.`/ - ` : | |
         \  \ `_.   \_ __\ /__ _/   .-` /  /
     =====`-.____`.___ \_____/___.-`___.-'=====
                       `=---='


     ~~~~~~~~~~~~~~~~~~~~~~~~~~~~~~~~~~~~~~~~~~~

           佛祖保佑       永不宕机     永无BUG
"""

import Rhino.Geometry as rh
from scriptcontext import doc
import rhinoscriptsyntax as rs

ds = _split_direction
ss = _split_degree
#curve = _project_base

tol = doc.ModelAbsoluteTolerance

## setback the base
base_polyline = rh.PolylineCurve.ToPolyline(rh.Curve.ToPolyline(_project_base, tol, tol, 1000, 1000))
centpt = rh.Polyline.CenterPoint(base_polyline)
XYplane = rh.Plane(centpt, rs.coerce3dvector([0, 0, 1]))

condition = rh.CurveOffsetCornerStyle.Sharp
array_setback = rh.Curve.Offset(_project_base, XYplane, _setback, tol, condition)

if len(array_setback) > 1:
    jointed_setback = rh.Curve.JoinCurves(array_setback)
else:
    jointed_setback = array_setback

curve = jointed_setback[0]

## function to split one curve by direction (d) and split (s) parameter

def rotate_bounding_box(base, bounding, angle):
    ## Not be used
    
    centpt = rh.AreaMassProperties.Compute(_project_base).Centroid
    scale = rh.Transform.Scale(rh.Plane.WorldXY, 5, 5, 1)
    rotate = rh.Transform.Rotation(angle, rh.Plane.WorldXY.ZAxis, centpt)
    
    bounding.Transform(scale)
    bounding.Transform(rotate)
    
    return bounding

def split_curve(curve, d, s):
    #    bb = rh.Curve.GetBoundingBox(
    
    bb = curve.GetBoundingBox(True)
#    bbo = curve.GetBoundingBox(True)
#    bb = rotate_bounding_box(curve, bbo, _rotate_angle)
    
    base_pt = rh.Point3d(bb.Min.X, bb.Min.Y, 0.0)
    
    x = bb.Max.X - bb.Min.X
    y = bb.Max.Y - bb.Min.Y
#    print(x, y)
    dims = [x, y]
    vecs = [rh.Vector3d(1,0,0), rh.Vector3d(0,1,0)]
    
    vec_1 = vecs[d] * dims[d] * s
    new_pt_1 = rh.Point3d(base_pt)
    new_pt_1.Transform(rh.Transform.Translation(vec_1))
    
    other_dir = abs(d - 1)
    
    vec_2 = vecs[other_dir] * dims[other_dir]
    new_pt_2 = rh.Point3d(new_pt_1)
    new_pt_2.Transform(rh.Transform.Translation(vec_2))
    
    
    split_line = rh.Line(new_pt_1, new_pt_2).ToNurbsCurve()
    
    inter = rh.Intersect.Intersection.CurveCurve(curve, split_line, tol, tol)
    p = [i.ParameterA for i in inter]
    
    if len(p) > 2:
        for i in range(len(p)):
            
            pt1 = curve.PointAt(p[i-1])
            pt2 = curve.PointAt(p[i])
            
            line = rh.Line(pt1, pt2).ToNurbsCurve()
            cp = line.PointAtNormalizedLength(0.5)
            
            if (curve.Contains(cp) == rh.PointContainment.Inside and 
                    len(rh.Intersect.Intersection.CurveCurve(curve, line, tol, tol)) <= 2):
                p = [p[i-1], p[i]]
                break
    
    pieces = curve.Split(p)
    
    curves = []
    
    for piece in pieces:
        line = rh.Line(piece.PointAtStart, piece.PointAtEnd)
        curve = rh.NurbsCurve.JoinCurves([piece, line.ToNurbsCurve()])
        curves += curve
    
    return curves


def split_recursively(curves, ds, ss):
    
    if len(ds) == 0 or len(ss) == 0:
        return curves
    
    curve = curves.pop(0)
    d = ds.pop(0)
    s = ss.pop(0)
    
    curves += split_curve(curve, d, s)
    
    print(len(curves))
    
    return split_recursively(curves, ds, ss)
print(curve)
print(ds)
print(ss)

splited_space_ = split_recursively([curve], ds, ss)
setbacked_base_ = curve
# ---------- end split_base ----------

# ----
north_south_zones = GhPythonScript()  # -> out, a; inputs base: Curve
# ---------- north_south_zones: Python ----------
import Rhino.Geometry as rg

def generate_rectangles(base, offset=10.0):
    # 找到多边形的纵向分割线
    bbox = base.GetBoundingBox(True)
    center = bbox.Center
    start = rg.Point3d(center.X, bbox.Min.Y, 0)
    end = rg.Point3d(center.X, bbox.Max.Y, 0)

    # 将分割线延长到可包裹多边形的纵向长度
    diagonal = bbox.Diagonal
    length = diagonal.Length
#    extension_factor = length
    extension_factor = (length / 2.0)
    start_extended = rg.Point3d.Add(start, rg.Vector3d(start - center) * extension_factor)
    end_extended = rg.Point3d.Add(end, rg.Vector3d(end - center) * extension_factor)

    # 复制分割线并向左右两侧都复制一份
    left_start = rg.Point3d(start_extended.X - diagonal.X/2.0 - offset, start_extended.Y, 0)
    left_end = rg.Point3d(end_extended.X - diagonal.X/2.0 - offset, end_extended.Y, 0)
    
    right_start = rg.Point3d(start_extended.X + diagonal.X/2.0 + offset, start_extended.Y, 0)
    right_end = rg.Point3d(end_extended.X + diagonal.X/2.0 + offset, end_extended.Y, 0)

    # 将分割线的起点终点与复制结果的起点终点对应连线，组合成为两个矩形
    left_up_cup = rg.LineCurve(start_extended, left_start)
    left_down_cup = rg.LineCurve(end_extended, left_end)
    left_start_cup = rg.LineCurve(start_extended, end_extended)
    left_end_cup = rg.LineCurve(left_start, left_end)
    
    right_up_cup = rg.LineCurve(start_extended, right_start)
    right_down_cup = rg.LineCurve(end_extended, right_end)
    right_start_cup = rg.LineCurve(start_extended, end_extended)
    right_end_cup = rg.LineCurve(right_start, right_end)
    
    # 连线为两个Zones
    
    left_zone = rg.Curve.JoinCurves([left_up_cup, left_down_cup, left_start_cup, left_end_cup])
    right_zone = rg.Curve.JoinCurves([right_up_cup, right_down_cup, right_start_cup, right_end_cup])
    
    # 传回结果
    return [left_zone, right_zone]

a = generate_rectangles(base)[0]
# ---------- end north_south_zones ----------
east_west_zones = GhPythonScript()  # -> out, a; inputs base: Curve; same code as north_south_zones
wallacei_x = WallaceiX(popGen="-1,-1", total="0", wlcDone=False)  # -> WallaceiGenomes, FitnessValues, Data, Phenotypes
curve = Curve(split_base.splited_space)
